vi "spectrum _analisis.gvi"   [LabVIEW NXG 1.0.0]
panel controls:
  "duration": f64 = 1
  "window type": "Window Type.gtype" = "Hanning"(1)
  "peaks count": i32 = 10
  "restart": bool
  "recalculate": bool
  "stop": bool
  "file path": path
  "threshold": f64 = 18
  "min peak width": f64 = 1
  "max peak width": f64 = 20
  "save to file": bool
  "letter": T2 = "A"
  "save to clipboard": bool
  "guess": bool
panel indicators:
  "data": waveform<f64>[]
  "spectrum": T1[]
  "frequency peaks": f64[]
  "amplitudes": f64[]
  "half value widths": f64[]
  "letter amplitudes": f64[]
  "guessed": T2
types:
  "Window Type.gtype" = u32
  T1 = cluster{"f0": f64, "df": f64, "magnitude": f64[]}
  T2 = enum{"A", "Á", "E", "É", "I", "O", "Ö", "U", "Ü"}
uses:
  NI::Analysis::Measurement::FFT Spectrum (Mag-Phase) for N Chan.gvi
  Library.sli::get_peaks
  Library.sli::guess_letter
  Library.sli::output_to_file
diagram:
  Add("Ü", 1) -> w1
  Initialize Array(element=0, size=w1, size=0) -> w2
  s1 = w2  # shift register
  while {
    sequence {
      frame 0 {
        w3 = "mic"  # task in
        Is Greater(x=$duration, y=0) -> w4
        case (w4) {
          frame False, Default {
            w5 = w3
            w6 = waveform<f64>[] []
            w7 = no error
          }
          frame True {
            call "DAQmx Start Task.gvi"(error in=no error, task in=w3) -> (error out=w8, task out=w9)
            call "DAQmx Read (Analog 1D Wfm NChan NSamp Duration).gvi"(error in=w8, task in=w9, duration=$duration) -> (error out=w7, task out=w5, data=w6)
          }
        }
        s2 = s1  # shift register
        while {
          $data <- w6
          call "FFT Spectrum (Mag-Phase) for N Chan.gvi"(signal=w6, window type=$"window type", error in=w7) -> (magnitude=w10, error out=w11)
          $spectrum <- w10
          w12 = $"peaks count"
          Initialize Array(element=0, size=w12) -> w13
          Initialize Array(element=0, size=w12) -> w14
          Initialize Array(element=0, size=w12) -> w15
          Array Index(array=w10) -> (out0[0]=w16)
          Property Node(instance in=w16) -> ("magnitude"=w17)
          Property Node(instance in=w16) -> ("df"=w18)
          Array Size(array=w17) -> (size(s)=w19)
          To Unsigned Quad Integer(number=w19) -> w20
          Array Size(array=w14) -> (size(s)=w21)
          To Unsigned Quad Integer(number=w21) -> w22
          Array Size(array=w15) -> (size(s)=w23)
          To Unsigned Quad Integer(number=w23) -> w24
          Array Size(array=w13) -> (size(s)=w25)
          To Unsigned Quad Integer(number=w25) -> w26
          call "get_peaks"(in in=w17, in_size in=w20, out_freq in=w14, out_freq_max_size in=w22, out_hvw in=w15, out_hvw_max_size in=w24, out_amp in=w13, out_amp_max_size in=w26, df in=w18, threshold in=$threshold, min_search_freq in=$"min peak width", max_search_freq in=$"max peak width") -> (out_freq out=w27, out_hvw out=w28, out_amp out=w29)
          $"frequency peaks" <- w27
          $"half value widths" <- w28
          $amplitudes <- w29
          s3 = s2  # shift register
          while {
            Array Size(array=s3) -> (size(s)=w30)
            Array Index(array=w30) -> (out0[0]=w31)
            Reshape Array(inArray=s3, size=w31, size=w12) -> w32
            case ($"save to clipboard") {
              frame False, Default {
                w33 = w32
              }
              frame True {
                Delete From Array(inArray=w32, index0=$letter) -> w34
                Insert Into Array(inArray=w34, index0=$letter, new=w29) -> w33
              }
            }
            case ($guess) {
              frame False, Default { }
              frame True {
                Array Size(array=w33) -> (size(s)=w35)
                Array Index(array=w35) -> (out0[0]=w36)
                Array Index(array=w35) -> (out0[1]=w37)
                Array Size(array=w29) -> (size(s)=w38)
                call "guess_letter"(in in=w29, in_size in=w38, samples in=w33, samples_height in=w36, samples_width in=w37) -> (return=w39)
                $guessed <- w39
              }
            }
            Array Index(array=w33) -> (out0[$letter, _]=w40)
            $"letter amplitudes" <- w40
            case ($"save to file") {
              frame False, Default { }
              frame True {
                Array Size(array=w27) -> (size(s)=w41)
                To Unsigned Quad Integer(number=w41) -> w42
                Array Size(array=w28) -> (size(s)=w43)
                To Unsigned Quad Integer(number=w43) -> w44
                Array Size(array=w29) -> (size(s)=w45)
                To Unsigned Quad Integer(number=w45) -> w46
                call "output_to_file"(file_path in=$"file path", freq in=w27, freq_size in=w42, hvw in=w28, hvw_size in=w44, amp in=w29, amp_size in=w46)
              }
            }
            Wait(time to wait=50)
            w47 = $restart
            w48 = $stop
            Logical Or(w47, w48) -> w49
            Logical Or($recalculate, w49) -> w50
            next s3 = w33
            stop if w50
          }
          Logical Or(w47, w48) -> w51
          next s2 = s3
          stop if w51
        }
      }
    }
    sequence {
      frame 0 {
        call "DAQmx Stop Task.gvi"(error in=w11, task in=w5) -> (error out=w52, task out=w53)
        call "DAQmx Clear Task.gvi"(error in=w52, task in=w53)
      }
    }
    next s1 = s2
    stop if w48
  }
